# Grasshopper definition definition.gh (Grasshopper 0.9.75)
# plug-ins: LunchBox

srf = Surface(<surface referenced from the Rhino model>)
trib = TrianglePanelsB(Surface=srf, UDivisions=10, VDivisions=10)
id = Guid(srf)
demesh = DeconstructMesh(Mesh=trib)  # -> Vertices, Faces, Colours, Normals
panel = Panel(demesh.Normals)
panel_2 = Panel(demesh.Vertices)
panel_3 = Panel("""This is a test
I am a surface
A really cool triangular mesh""")
c_script = CSharpScript(x=panel)  # -> out, A; inputs x: String
# ---------- c_script: C# ----------
    string[] stringSeparators = new string[] {"{",",","}"};
    string[] words = x.Split(stringSeparators, StringSplitOptions.RemoveEmptyEntries);

    string ns = words[0] + "f," + words[1] + "f," + words[2] + "f,";

    A = ns;
# ---------- end c_script ----------
c_script_2 = CSharpScript(x=panel_2)  # -> out, A; inputs x: String; same code as c_script
panel_4 = Panel(c_script_2.A)
c_script_3 = CSharpScript(name=id, V=flatten(c_script_2.A), N=flatten(c_script.A), D=panel_3)  # -> out, A; inputs name: String, V: list of String, N: list of String, D: list of String
# ---------- c_script_3: C# ----------
    Dictionary < string, Dictionary<string, List<string>>> myDict = new Dictionary <string, Dictionary<string, List<string>>>();

    Dictionary<string, List<string>> myGeo = new Dictionary<string, List<string>>();



    myGeo.Add("vertices", V);
    myGeo.Add("normals", N);
    myGeo.Add("data", D);

    myDict.Add(name, myGeo);

    List<string> output = new List<string>();
    output.Add("{ name");
    output.Add(name);
    output.Add("vertices {");

    foreach (string vs in V)
    {
      output.Add(vs);
    }


    A = output;
# ---------- end c_script_3 ----------
panel_5 = Panel(c_script.A)
panel_6 = Panel(c_script_3.A)
